% Simulink data dictionary vf_ctrl_dd.sldd

T_HF_TASK = Simulink.Parameter(0.0001)
MOTOR_TYPE_TG5P60 = Simulink.Parameter(3, DataType="uint8")
MOTOR_TYPE_TB2P = Simulink.Parameter(11, DataType="uint8")
INT16_MIN = Simulink.Parameter(-32768, DataType="int16")
INT16_MAX = Simulink.Parameter(32767, DataType="int16")
VBUS = Simulink.Parameter(24, StorageClass="Define", HeaderFile="model_param.h", DataType="single")
PWM_PERIOD_CYCLES = Simulink.Parameter(7200, StorageClass="Define", HeaderFile="model_param.h", DataType="uint16")
mcu_ccrx = Simulink.Signal(StorageClass="ExportedGlobal", DataType="uint16")
spd_ref = Simulink.Signal(StorageClass="ExportedGlobal", DataType="int16", InitialValue="200")
MOTOR_TYPE_JSF630 = Simulink.Parameter(21, DataType="uint8")
MOTOR_TYPE = Simulink.Parameter(11, StorageClass="Define", HeaderFile="model_param.h", DataType="uint8")
MOTOR_PNF = Simulink.Parameter(2, StorageClass="Define", HeaderFile="model_param.h")
MOTOR_PN = Simulink.Parameter(uint8(2), StorageClass="Define", HeaderFile="model_param.h")
MOTOR_RS = Simulink.Parameter(0.575, StorageClass="Define", HeaderFile="model_param.h")
MOTOR_LS = Simulink.Parameter(0.00105, StorageClass="Define", HeaderFile="model_param.h")
MOTOR_KE = Simulink.Parameter(5.96708, StorageClass="Define", HeaderFile="model_param.h")
MOTOR_J = Simulink.Parameter(7.5e-6, StorageClass="Define", HeaderFile="model_param.h")
MOTOR_F = Simulink.Parameter(6.3e-6, StorageClass="Define", HeaderFile="model_param.h")
MOTOR_TL = Simulink.Parameter(0.001, StorageClass="Define", HeaderFile="model_param.h")